# Grasshopper definition 0717.gh (Grasshopper 1.0.8)
# plug-ins: RhinoCodePluginGH

# ----
# TriRemesh l10 i10 (heat)
mesh = Mesh(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)

# ----
# TriRemesh l10 i10 (heat)
mesh_2 = Mesh(mesh)

# ----
# heat value
cs = CSharpScript(M=mesh_2)  # -> out, heat_value; inputs M: Mesh
# ---------- cs: C# ----------
// Grasshopper Script Instance
using System;
using System.Collections;
using System.Collections.Generic;
using System.Drawing;

using Rhino;
using Rhino.Geometry;

using Grasshopper;
using Grasshopper.Kernel;
using Grasshopper.Kernel.Data;
using Grasshopper.Kernel.Types;

public class Script_Instance : GH_ScriptInstance
{
  /* 
    Members:
      RhinoDoc RhinoDocument
      GH_Document GrasshopperDocument
      IGH_Component Component
      int Iteration

    Methods (Virtual & overridable):
      Print(string text)
      Print(string format, params object[] args)
      Reflect(object obj)
      Reflect(object obj, string method_name)
  */
  
  private void RunScript(Mesh M, ref object heat_value)
  {

    List<double> h_values = new List<double>();
    for (int i = 0; i < M.Vertices.Count; i++)
    {
        h_values.Add(M.TextureCoordinates[i].Y);
    }
    
    heat_value = h_values;
  }


}
# ---------- end cs ----------
panel = Panel(cs.heat_value)

# ----
# elem_center
demesh = DeconstructMesh(Mesh=mesh_2)  # -> Vertices, Faces, Colours, Normals
pdecon = Deconstruct(Point=demesh.Vertices)  # -> graft(XComponent), graft(YComponent), graft(ZComponent)
merge = Merge(Data1=pdecon.XComponent, Data2=pdecon.YComponent, Data3=pdecon.ZComponent)
join = TextJoin(Text=merge, Join=",")  # -> flatten(Result)
panel_2 = Panel(join)

# ----
# Adjacenet_edges
cs_2 = CSharpScript(M=mesh_2)  # -> out, Adjacent_edges; inputs M: Mesh
# ---------- cs_2: C# ----------
// Grasshopper Script Instance
using System;
using System.Collections;
using System.Collections.Generic;
using System.Drawing;

using Rhino;
using Rhino.Geometry;

using Grasshopper;
using Grasshopper.Kernel;
using Grasshopper.Kernel.Data;
using Grasshopper.Kernel.Types;

public class Script_Instance : GH_ScriptInstance
{
  /* 
    Members:
      RhinoDoc RhinoDocument
      GH_Document GrasshopperDocument
      IGH_Component Component
      int Iteration

    Methods (Virtual & overridable):
      Print(string text)
      Print(string format, params object[] args)
      Reflect(object obj)
      Reflect(object obj, string method_name)
  */
  
  private void RunScript(Mesh M, ref object Adjacent_edges)
  {
    if (M == null)
    {
        Print("Invalid Mesh");
        return;
    }
    List<string> edgeInfoList = new List<string>();

    for (int i = 0; i < M.TopologyEdges.Count; i++)
    {
        IndexPair edgeIndices = M.TopologyEdges.GetTopologyVertices(i);

        edgeInfoList.Add(string.Format("{1},{2}", i, edgeIndices.I, edgeIndices.J));
    }

        Adjacent_edges = edgeInfoList;
    }

  }
# ---------- end cs_2 ----------
# 1. Export CSV
panel_3 = Panel(cs_2.Adjacent_edges)

# ----
# Heat Texture
path = FilePath("C:\Users\jenny\Desktop\0718\gh\colormap-opacity-40.png")
c_script = CSharpScript(texture=path)  # -> out, A; inputs texture: String
# ---------- c_script: C# usings ----------
using Rhino.DocObjects;
# ---------- c_script: C# ----------
    Material material = new Material();
    material.SetBitmapTexture(texture);
    A = new GH_Material(Rhino.Render.RenderMaterial.CreateBasicMaterial(material));
# ---------- end c_script ----------
preview = CustomPreview(Geometry=mesh_2, Material=c_script.A)

# ----
# Contour Count
number_slider = Slider(158, range=0..200)

# ----
# Preview (before NN)
c_script_2 = CSharpScript(M=mesh_2, contourCount=number_slider)  # -> out, Contours; inputs M: Mesh, contourCount: Int32
# ---------- c_script_2: C# usings ----------
using System.Linq;
using System.Threading.Tasks;
# ---------- c_script_2: C# ----------
    List<Line> all = new List<Line>();
    List<Line>[] contours = new List<Line>[contourCount];
    double[] values = new double[M.Vertices.Count];
    for(int i = 0;i < M.Vertices.Count;i++) values[i] = M.TextureCoordinates[i].Y;
    double lower = values.Min();
    double upper = values.Max();
    double stepsize = (upper - lower) / (contourCount + 1.0);

    Parallel.For(0, contourCount,
      j => {
      double iso = lower + ((j + 1) * stepsize);
      List<Line> lines = new List<Line>();
      for(int i = 0;i < M.Faces.Count;i++)
      {
        int va = M.Faces[i].A;
        int vb = M.Faces[i].B;
        int vc = M.Faces[i].C;
        double a = M.TextureCoordinates[va].Y - iso;
        double b = M.TextureCoordinates[vb].Y - iso;
        double c = M.TextureCoordinates[vc].Y - iso;
        Point3d pa = M.Vertices.Point3dAt(va);
        Point3d pb = M.Vertices.Point3dAt(vb);
        Point3d pc = M.Vertices.Point3dAt(vc);

        List<Point3d> ends = new List<Point3d>();
        if(a < 0 != b < 0)
        {
          double wa = b / (b - a);
          double wb = 1 - wa;
          ends.Add(wa * pa + wb * pb);
        }
        if(a < 0 != c < 0)
        {
          double wa = c / (c - a);
          double wc = 1 - wa;
          ends.Add(wa * pa + wc * pc);
        }
        if(c < 0 != b < 0)
        {
          double wb = c / (c - b);
          double wc = 1 - wb;
          ends.Add(wb * pb + wc * pc);
        }
        if(ends.Count == 2) lines.Add(new Line(ends[0], ends[1]));
      }
      contours[j] = lines;
      });

    DataTree<Line> contoursTree = new DataTree<Line>();
    for(int i = 0; i < contourCount;i++)
    {
      GH_Path path = new GH_Path(i);
      for (int j = 0; j < contours[i].Count;j++)
      {
        contoursTree.Add(contours[i][j], path);
      }
    }

    Contours = contoursTree;
# ---------- end c_script_2 ----------
crv = Curve(c_script_2.Contours)

# ----
# Alpha
swatch = ColourSwatch(SwatchColor=RGBA(255, 255, 255, 220))
preview_2 = CustomPreview(Geometry=mesh_2, Material=swatch)

# ----
# 移動一下方便跟原本的比較
number_slider_2 = Slider(500, range=0..1000)
X = UnitX(Factor=number_slider_2)
move = Move(Geometry=mesh, Motion=X)  # -> Geometry, Transform

# ----
# Mesh
medges = MeshEdges(Mesh=mesh_2)  # -> NakedEdges, InteriorEdges, NonManifoldEdges

# ----
# total_loss = base_loss + 0.1* uniform_loss + 0.1* directional_loss
panel_4 = Panel("..\demo\output_heat_optimized-0_1-0_1.csv")

# ----
# 2. 輸入更新後的 heat_value (.csv)
# 讀取 NN 後更新的 Mesh 的熱值
path_2 = FilePath(panel_4)
file = ReadFile(File=path_2, PerLineParse=True)
split = SplitList(List=file, Index="1")  # -> ListA, ListB
data = Data(split.ListB)
cs_3 = CSharpScript(M=move.Geometry, heat_value=data)  # -> out, new_mesh; inputs M: Mesh, heat_value: list of Double
# ---------- cs_3: C# ----------
// Grasshopper Script Instance
using System;
using System.Collections;
using System.Collections.Generic;
using System.Drawing;

using Rhino;
using Rhino.Geometry;

using Grasshopper;
using Grasshopper.Kernel;
using Grasshopper.Kernel.Data;
using Grasshopper.Kernel.Types;

public class Script_Instance : GH_ScriptInstance
{
  /* 
    Members:
      RhinoDoc RhinoDocument
      GH_Document GrasshopperDocument
      IGH_Component Component
      int Iteration

    Methods (Virtual & overridable):
      Print(string text)
      Print(string format, params object[] args)
      Reflect(object obj)
      Reflect(object obj, string method_name)
  */
  
  private void RunScript(Mesh M, IList<double> heat_value, ref object new_mesh)
  {
    for (int i = 0; i < M.Vertices.Count; i++)
    {
       M.TextureCoordinates.SetTextureCoordinate(i, new Point2f(0, (float) (heat_value[i])));
    }
    new_mesh = M;
    

  }


}
# ---------- end cs_3 ----------

# ----
# heat method + NN
mesh_3 = Mesh(cs_3.new_mesh)

# ----
# Heat Texture
path_3 = FilePath("C:\Users\jenny\Desktop\0718\gh\colormap-opacity-40.png")
c_script_3 = CSharpScript(texture=path_3)  # -> out, A; inputs texture: String; same code as c_script
preview_3 = CustomPreview(Geometry=mesh_3, Material=c_script_3.A)

# ----
# Contour Count
number_slider_3 = Slider(158, range=0..200)

# ----
# Preview (after NN)
c_script_4 = CSharpScript(M=mesh_3, contourCount=number_slider_3)  # -> out, Contours; inputs M: Mesh, contourCount: Int32; same code as c_script_2
crv_2 = Curve(c_script_4.Contours)

# ---- group: Colour Swatch
# Alpha
swatch_2 = ColourSwatch(SwatchColor=RGBA(255, 255, 255, 220))

# ----
preview_4 = CustomPreview(Geometry=mesh_3, Material=swatch_2)

# ----
# Mesh
medges_2 = MeshEdges(Mesh=mesh_3)  # -> NakedEdges, InteriorEdges, NonManifoldEdges
